# Grasshopper definition truss.gh (Grasshopper 1.0.7)
# plug-ins: GrasshopperMidasLink, GH_CPython, LunchBox, EleFront, Kangaroo2 Components

boolean_toggle = BooleanToggle(True)

文件路径_需将反斜杠替换为正斜杠 = Panel("F:/2024/01 GenApi开发者大赛/study.mgb")

panel = Panel("""H500x200
H800x300
H1000x400""")
panel_2 = Panel("""200
300
400""")
panel_3 = Panel("""20
25
30""")
panel_4 = Panel("""20
18
30""")
panel_5 = Panel("""500
800
100""")
panel_6 = Panel("8")
number_slider = Slider(200, range=0..1000)
number_slider_2 = Slider(20, range=0..100)
panel_7 = Panel("popo")

panel_8 = Panel("""口600x300
口800x400""")
panel_9 = Panel("""300
400""")
panel_10 = Panel("""20
30""")
panel_11 = Panel("""600
800""")

boolean_toggle_2 = BooleanToggle(False)
panel_12 = Panel("1")
text_split = TextSplit(Text="89x5", Separators="x")
list_item = ListItem(List=text_split, Index=0, Wrap=True)  # -> Item, Item1

# ---- group: 设置单位
gh_cpython = GH_CPython(run=Toggle(False), Unit="4")  # inputs run: list, Unit: list
# ---------- gh_cpython: Python ----------
# -*- coding: utf-8 -*-
""" 
[desc]
if Unit is 1:the unit is"N.M",
if Unit is 2:the unit is"KN.M"
if Unit is 3:the unit is"N.MM"
if Unit is 4:the unit is"KN.MM"
[/desc]
"""
import requests
import json
import math
#define api function
import Midas_Gen_API
from Midas_Gen_API import *

if run:
    unit_json = {"Assign":{}}
    if Unit==1:
        unit_json = {"Assign":{
            "1":{
            "DIST": "M", 
            "FORCE": "N"}
            } }
        unit_res=midas_api("PUT", '/db/unit',unit_json) 
    elif Unit==2:
         unit_json = {"Assign":{
            "1":{
            "DIST": "M", 
            "FORCE": "KN"}
             } }
         unit_res=midas_api("PUT", '/db/unit',unit_json) 
    elif Unit==3:
         unit_json = {"Assign":{
            "1":{
            "DIST": "MM", 
            "FORCE": "N"}
            } }
         unit_res=midas_api("PUT", '/db/unit',unit_json) 
    elif Unit==4:
         unit_json = {"Assign":{
            "1":{
            "DIST": "MM", 
            "FORCE": "KN"}
            } }
         unit_res=midas_api("PUT", '/db/unit',unit_json)
# ---------- end gh_cpython ----------

# ----
panel_13 = Panel("x")
panel_14 = Panel("""300x800
200x500
600x900
700x1000""")
panel_15 = Panel("500")

midas_setting = MidasSetting()  # -> APIURL, APIKey

# ---- group: 创建新项目
gh_cpython_2 = GH_CPython(bNew=Toggle(False))  # -> API_KEY; inputs bNew: list
# ---------- gh_cpython_2: Python ----------
# -*- coding: utf-8 -*-
""" 
[desc]
create project
[/desc]
"""
import requests
import json
import math
#define api function
import Midas_Gen_API
from Midas_Gen_API import *
if bNew:
    project_json={"Assign":{}}
    new_p=midas_api("POST", '/doc/new',project_json)
# ---------- end gh_cpython_2 ----------

# ---- group: 定义结构类型
gh_cpython_3 = GH_CPython(
    SType="0",
    bSelfWeight=boolean_toggle,
    SMassType=Slider(2, range=0..10),
    bAlignBeam=boolean_toggle,
    bAlignSlab=boolean_toggle)  # -> API_URL, API_KEY; inputs SType: list, bSelfWeight: list, SMassType: list, bAlignBeam: list, bAlignSlab: list
#   port API_URL: indicate your output description here. refers to a new line.
# ---------- gh_cpython_3: Python ----------
# -*- coding: utf-8 -*-
""" 
[desc]
- ID = “1”
- 3-D : 0
- X-Z Plane : 1
- Y-Z Plane : 2
- X-Y Plane : 3
- Constraint RZ : 4
- Lumped Mass : 1
- Consistent Mass : 2
- Convert to X, Y, Z : 1
- Convert to X, Y : 2
- Convert to Z : 3
[/desc]
"""
import requests
import json
import math
#define api function
import Midas_Gen_API
from Midas_Gen_API import *
structure_type={"Assign":{
    "1":{
        "STYP":SType,
        "bSELFWEIGHT":bSelfWeight,
        "SMASS":SMassType,
        "bALIGNBEAM":bAlignBeam,
        "bALIGNSLAB":bAlignSlab,#consider slab top align
    }
}}

      
structure_type_res=midas_api("PUT", '/db/STYP',structure_type)
# ---------- end gh_cpython_3 ----------

# ----
text_split_2 = TextSplit(Text=panel_14, Separators="x")

# ---- group: 打开Gen
gh_cpython_4 = GH_CPython(bOpen=Toggle(False), Gen_dir="C:\Program Files\MIDAS\midas Gen\MidasGen.exe")  # inputs bOpen: list, Gen_dir: list
#   port bOpen: [required] - [type = int] - [default = None] Descripe your input here * bullet point. * bullet point
# ---------- gh_cpython_4: Python ----------
# -*- coding: utf-8 -*-
""" 
[desc]
Open Gen
[/desc]"""
import subprocess
if bOpen:
    process = subprocess.Popen(Gen_dir, stdout=subprocess.PIPE, stderr=subprocess.PIPE)
    output, error = process.communicate()
    output = output.decode('utf-8')
    error = error.decode('utf-8')
    print('Output:')
    print(output)
#if error
    if error:
        print('Error:')
        print(error)
# ---------- end gh_cpython_4 ----------

# ---- group: 打开项目
gh_cpython_5 = GH_CPython(bOpen=Toggle(False), P_Dir=文件路径_需将反斜杠替换为正斜杠)  # -> API_KEY; inputs bOpen: list
# ---------- gh_cpython_5: Python ----------
# -*- coding: utf-8 -*-
""" 
[desc]
open project
[/desc]
"""
import requests
import json
import math
#define api function
import Midas_Gen_API
from Midas_Gen_API import *
if bOpen:
    #file_path=P_Dir.replace("\","/")
    #print(file_path)
    project_json={"Argument" :P_Dir}
    Open_p=midas_api("POST", '/doc/open',project_json)

print(project_json)
# ---------- end gh_cpython_5 ----------

# ---- group: 箱形截面，支持同一类型截面连续添加
gh_cpython_6 = GH_CPython(SectName=panel_8, bShearDeform=Toggle(True), H=panel_11, B=panel_9, tw=panel_10, tf=panel_10, C=panel_9)  # -> SectName; inputs StartSectID: list, SectName: list, bShearDeform: list, H: list, B: list, tw: list, tf: list, C: list
# ---------- gh_cpython_6: Python ----------
# -*- coding: utf-8 -*-
""" 
[desc]
StartSectID:int 
[/desc]
"""
import requests
import json
import math
#define api function
import Midas_Gen_API
from Midas_Gen_API import *
start_sect_id=StartSectID
sect_json = {"Assign" : {}}


if type(H)==int:
    sect_json["Assign"][start_sect_id]={
    "SECTTYPE" : "DBUSER",
    "SECT_NAME" : SectName,
    "SECT_BEFORE" : {
        "USE_SHEAR_DEFORM" : bShearDeform,
        "SHAPE": "B",
        "DATATYPE": 2,
        "SECT_I": {
            "vSIZE" : [H,B,tw,tf,B-tw,tf]
        }
    }}
else:
    sect_num=len(H)
    for i in range(sect_num):
        sect_json["Assign"][start_sect_id+i]={
        "SECTTYPE" : "DBUSER",
        "SECT_NAME" : SectName[i],
        "SECT_BEFORE" : {
            "USE_SHEAR_DEFORM" : bShearDeform,
            "SHAPE": "B",
            "DATATYPE": 2,
            "SECT_I": {
            "vSIZE" : [H[i],B[i],tw[i],tf[i],B[i]-tw[i],tf[i]]
             }   
        }}

SECT=midas_api("PUT", '/db/sect',sect_json)
print(json.dumps(sect_json,indent=4))
ectName=SectName
# ---------- end gh_cpython_6 ----------

# ----
list_item_2 = ListItem(List=text_split_2, Index=0, Wrap=True)  # -> flatten(Item), flatten(Item1)

# ---- group: 圆管截面，支持同一类型截面连续添加
gh_cpython_7 = GH_CPython(D=list_item.Item, tw=list_item.Item1)  # -> SectName; inputs StartSectID: list, SectName: list, bShearDeform: list, D: list, tw: list
# ---------- gh_cpython_7: Python ----------
# -*- coding: utf-8 -*-
""" 
[desc]
StartSectID:int 
[/desc]
"""
import requests
import json
import math
#define api function
import Midas_Gen_API
from Midas_Gen_API import *
start_sect_id=StartSectID
sect_json = {"Assign" : {}}
if type(D)==int:
    sect_json={"Assign":{start_sect_id:{
    "SECTTYPE" : "DBUSER",
    "SECT_NAME" : SectName,
    "SECT_BEFORE" : {
        "USE_SHEAR_DEFORM" : bShearDeform,
        "SHAPE": "P",
        "DATATYPE": 2,
        "SECT_I": {
            "vSIZE" :[ D, tw]}
        }
    }}}
else:
    for item in range(len(SectName)):
        sect_json["Assign"][start_sect_id+item]={
        "SECTTYPE" : "DBUSER",
        "SECT_NAME" : SectName[item],
        "SECT_BEFORE" : {
            "USE_SHEAR_DEFORM" : bShearDeform,
            "SHAPE": "P",
            "DATATYPE": 2,
            "SECT_I": {
                "vSIZE" : [D[item], tw[item]]
            }
        }}
     
SECT=midas_api("PUT", '/db/sect',sect_json)
#print(json.dumps(sect_json,indent=4))
ectName=SectName
# ---------- end gh_cpython_7 ----------

# ---- group: H形截面，支持同一类型截面连续添加
gh_cpython_8 = GH_CPython(H=number_slider, B1=number_slider, tw=number_slider_2, B2=number_slider, tf2=number_slider_2)  # -> SectName, r1, r2; inputs StartSectID: list, SectName: list, bShearDeform: list, H: list, B1: list, tw: list, tf1: list, B2: list, tf2: list, r1: list, r2: list
# ---------- gh_cpython_8: Python ----------
# -*- coding: utf-8 -*-
""" 
[desc]
StartSectID:int 
[/desc]
"""
import requests
import json
import math
#define api function
import Midas_Gen_API
from Midas_Gen_API import *
start_sect_id=StartSectID
sect_json = {"Assign" : {}}


R1=[]
R2=[]
for item in list(range(len(SectName))):
    if r1==None:

        R1.append(0)
    else:
        
        R1=r1
    if r2==None:

        R2.append(0)
    else:
        
        R2=r2
   
print(R1)
if type(H)==int:
      sect_json["Assign"][start_sect_id]={
        "SECTTYPE" : "DBUSER",
        "SECT_NAME" : SectName,
        "SECT_BEFORE" : {
            "USE_SHEAR_DEFORM" : bShearDeform,
            "SHAPE": "H",
            "DATATYPE": 2,
            "SECT_I": {
                "vSIZE" : [H,B1,tw,tf1,B2,tf2,R1,R2]
            }
        }}
else:
    for item in list(range(len(SectName))):
        
        sect_json["Assign"][start_sect_id+item]={
        "SECTTYPE" : "DBUSER",
        "SECT_NAME" : SectName[item],
        "SECT_BEFORE" : {
            "USE_SHEAR_DEFORM" : bShearDeform,
            "SHAPE": "H",
            "DATATYPE": 2,
            "SECT_I": {
                "vSIZE" : [H[item],B1[item],tw[item],tf1[item],B2[item],tf2[item],R1[item],R2[item]]
            }
        }}
     
SECT=midas_api("PUT", '/db/sect',sect_json)
print(json.dumps(sect_json,indent=4))
ectName=SectName
# ---------- end gh_cpython_8 ----------

# ---- group: SB（实腹式矩形）截面，支持同一类型截面连续添加
gh_cpython_9 = GH_CPython(StartSectID="1", bShearDeform=Toggle(True), Width=list_item_2.Item, Height=list_item_2.Item1)  # -> SectName; inputs StartSectID: list, SectName: list, bShearDeform: list, Width: list, Height: list
# ---------- gh_cpython_9: Python ----------
# -*- coding: utf-8 -*-
""" 
[desc]
StartSectID:int 
[/desc]
"""
import requests
import json
import math
#define api function
import Midas_Gen_API
from Midas_Gen_API import *
start_sect_id=StartSectID
sect_json = {"Assign" : {}}
if type(Height)==int:
    sect_json={"Assign":{start_sect_id:{
    "SECTTYPE" : "DBUSER",
    "SECT_NAME" : SectName,
    "SECT_BEFORE" : {
        "USE_SHEAR_DEFORM" : bShearDeform,
        "SHAPE": "SB",
        "DATATYPE": 2,
        "SECT_I": {
            "vSIZE" :[ Height, Width]}
        }
    }}}
else:
    for item in range(len(SectName)):
        sect_json["Assign"][start_sect_id+item]={
        "SECTTYPE" : "DBUSER",
        "SECT_NAME" : SectName[item],
        "SECT_BEFORE" : {
            "USE_SHEAR_DEFORM" : bShearDeform,
            "SHAPE": "SB",
            "DATATYPE": 2,
            "SECT_I": {
                "vSIZE" : [Height[item], Width[item]]
            }
        }}
     
SECT=midas_api("PUT", '/db/sect',sect_json)
#print(json.dumps(sect_json,indent=4))
ectName=SectName
# ---------- end gh_cpython_9 ----------

# ----
panel_16 = Panel("2")

# ---- group: 生成节点信息
gh_cpython_10 = GH_CPython()  # -> Pts; inputs Nodes: list
# ---------- gh_cpython_10: Python ----------
# -*- coding: utf-8 -*-
""" 
[desc]
input nodes
[/desc]
"""
import requests
import json
import math
#define api function
import Midas_Gen_API
from Midas_Gen_API import *

node_json = {"Assign":{}}
num_nodes=len(Nodes) 
for i in range(1,num_nodes+1):
    node_json["Assign"][  i] = {
        "X" : Nodes[i-1][0],
        "Y" : Nodes[i-1][1],
        "Z" : Nodes[i-1][2],
    }
NODES=midas_api("POST","/db/node",node_json)
#print(json.dumps(node_json,indent=4))
Pts=Nodes
# ---------- end gh_cpython_10 ----------

# ----
curve = Curve(<curve referenced from the Rhino model>)
curve_2 = Curve(<curve referenced from the Rhino model>)
_2d_truss = _2DTruss(CurveA=curve, CurveB=curve_2, Divisions="5", TrussToggle=0)  # -> PrimaryLines, BraceLines, VerticalLines, StructureNodes
series = Series(Start=0, Step=1, Count="12")
entwine = Entwine(Branch00=_2d_truss.PrimaryLines, Branch01=_2d_truss.BraceLines, Branch02=_2d_truss.VerticalLines, FlattenInputs=True)  # -> flatten(Result)
define_text_dot = DefineTextDot(Text=series, Location=_2d_truss.StructureNodes, Font="Arial", Size=14)
end_points = EndPoints(Curve=entwine)  # -> Start, End

surface = Surface(<surface referenced from the Rhino model>)
divide_domain² = DivideDomain²(Domain=surface, UCount="5", VCount="5")
series_2 = Series(Start=0, Step=1, Count="36")
isotrim = Isotrim(Surface=surface, Domain=divide_domain²)
deconstruct_brep = DeconstructBrep(Brep=isotrim)  # -> flatten(Faces), Edges, Vertices
removeduplicatepts = RemoveDuplicatePts(Points=flatten(deconstruct_brep.Vertices), Tolerance=0.01)
define_text_dot_2 = DefineTextDot(Text=series_2, Location=removeduplicatepts, Font="Arial", Size=14)

surface_2 = Surface(<surface referenced from the Rhino model>)

# ---- group: 板截面
gh_cpython_11 = GH_CPython(StartSlabID="1", SlabName="100mm", bINOUT=Toggle(False), T_in="100", T_out="0")  # -> SlabName; inputs StartSlabID: list, SlabName: list, bINOUT: list, T_in: list, T_out: list
# ---------- gh_cpython_11: Python ----------
# -*- coding: utf-8 -*-
""" 
[desc]
TYPE:"VALUE","STIFFENED"
[/desc]
"""
import requests
import json
import math
#define api function
import Midas_Gen_API
from Midas_Gen_API import *
start_slab_id=StartSlabID
slab_json = {"Assign" : {}}
if type(T_in)==int:
    slab_json={"Assign":{start_slab_id:{
    "NAME" : SlabName,
    "TYPE" : "VALUE",
    "bINOUT":bINOUT,
    "T_IN":T_in,
    "T_OUT":T_out,
    "O_VALUE":0
    }}}
else:
    for item in range(len(SlabName)):
        slab_json["Assign"][start_slab_id+item]={
            "NAME":SlabName[item],
            "TYPE":"VALUE",
            "bINOUT":bINOUT,
            "T_IN":T_in[item],
            "T_OUT":T_out[item],
            "O_VALUE":0}
     
SECT=midas_api("POST", '/db/thik',slab_json)
#print(json.dumps(sect_json,indent=4))
SlabName=SlabName
# ---------- end gh_cpython_11 ----------

# ----
deconstruct_brep_2 = DeconstructBrep(Brep=surface_2)  # -> flatten(Faces), Edges, Vertices

panel_17 = Panel("""1000000
1111110
1100000
1110000""")
panel_18 = Panel("""3
2
1
4""")

# ---- group: 实腹式圆形截面（SR），支持同一类型截面连续添加
gh_cpython_12 = GH_CPython(SectName="D1000", bShearDeform=Toggle(True), D="1000")  # -> SectName; inputs StartSectID: list, SectName: list, bShearDeform: list, D: list
# ---------- gh_cpython_12: Python ----------
# -*- coding: utf-8 -*-
""" 
[desc]
StartSectID:int 
[/desc]
"""
import requests
import json
import math
#define api function
import Midas_Gen_API
from Midas_Gen_API import *
start_sect_id=StartSectID
sect_json = {"Assign" : {}}
if type(D)==int:
    sect_json={"Assign":{start_sect_id:{
    "SECTTYPE" : "DBUSER",
    "SECT_NAME" : SectName,
    "SECT_BEFORE" : {
        "USE_SHEAR_DEFORM" : bShearDeform,
        "SHAPE": "SR",
        "DATATYPE": 2,
        "SECT_I": {
            "vSIZE" :[D]}
        }
    }}}
else:
    for item in range(len(SectName)):
        sect_json["Assign"][start_sect_id+item]={
        "SECTTYPE" : "DBUSER",
        "SECT_NAME" : SectName[item],
        "SECT_BEFORE" : {
            "USE_SHEAR_DEFORM" : bShearDeform,
            "SHAPE": "SR",
            "DATATYPE": 2,
            "SECT_I": {
                "vSIZE" : [D[item]]
            }
        }}
     
SECT=midas_api("PUT", '/db/sect',sect_json)
#print(json.dumps(sect_json,indent=4))
ectName=SectName
# ---------- end gh_cpython_12 ----------

# ---- group: 定义边界条件，可连续定义
gh_cpython_13 = GH_CPython(const_ID="2", Constraint=panel_17)  # -> Constraint; inputs Nodes_Support: list, const_ID: list, Constraint: list
#   port Constraint: indicate your output description here. refers to a new line.
# ---------- gh_cpython_13: Python ----------
# -*- coding: utf-8 -*-
""" 
[desc]
constraint "1 "is true "0" is false
DX,DY,DZ,RX,RY,RZ,RW
"Nodes_Support": nodes number to constr4aint
[/desc]
"""
import requests
import json
import math
#define api function
import Midas_Gen_API
from Midas_Gen_API import *
constraint_json={"Assign":{}}
if type(Nodes_Support)==int:
    constraint_json["Assign"][str(Nodes_Support)]={
    "ITEMS":[
             {
            "ID":const_ID,
            "CONSTRAINT":str(Constraint),
              }]
        }
    
else:
    support_count=len(Nodes_Support)
    for i in range(support_count):
         constraint_json["Assign"][str(Nodes_Support[i])]={
    "ITEMS":[
             {
            "ID":const_ID,
            "CONSTRAINT":str(Constraint[i]),
              }]
        }

#constraint_json={"Assign":{"1":{"ITEMS":[{"ID":1,"CONSTRAINT":"1000000"}]}}}
print(constraint_json)
#print(type(Nodes_Support))
      
Constraint=midas_api("POST", '/db/CONS',constraint_json)
# ---------- end gh_cpython_13 ----------

# ----
removeduplicatepts_2 = RemoveDuplicatePts(Points=flatten(deconstruct_brep_2.Vertices), Tolerance=0.01)
series_3 = Series(Start=0, Step=1, Count=12)

# ---- group: 生成一般单元（梁、桁架）
gh_cpython_14 = GH_CPython(
    start_node_ID="1",
    start_ele_ID="1",
    Nodes_S=end_points.Start,
    Nodes_E=end_points.End,
    Nodes=_2d_truss.StructureNodes,
    ElementType="BEAM",
    Mat_ID="1",
    Sect_ID="1")  # -> Nodes_ID, Element_ID; inputs start_node_ID: list, start_ele_ID: list, Nodes_S: list, Nodes_E: list, Nodes: list, ElementType: list, Mat_ID: list, Sect_ID: list, BetaAngle: list
#   port Element_ID: indicate your output description here. refers to a new line.
# ---------- gh_cpython_14: Python ----------
# -*- coding: utf-8 -*-
# -*- coding: utf-8 -*-
""" 
[desc]
create Element :
Element Type
*   Beam : "BEAM"
*   Plate : "PLATE"
*   Truss : "TRUSS"
*   Solid : "SOLID"
[/desc]
"""
import requests
import json
import math
#define api function
import Midas_Gen_API
from Midas_Gen_API import *

nodes_count=len(Nodes)

start_node_ID=start_node_ID
nodes_json = {"Assign" : {}}
nodes_map={}
if BetaAngle==None:
    Angle=0
else:
     Angle=BetaAngle
#create nodes
for i in range(nodes_count):
    nodes_json["Assign"][start_node_ID+i]={"X":Nodes[i][0],"Y":Nodes[i][1],"Z":Nodes[i][2]}
    nodes_map[tuple((Nodes[i]))]=i+1

#create elements
element_json={"Assign" :{}}
element_count=len(Nodes_E)
start_ele_ID=start_ele_ID
Element_ID=[]
for i in range(element_count):
    element_json["Assign"][start_ele_ID+i]={
    "TYPE":ElementType,
    "MATL":Mat_ID,
    "SECT":Sect_ID,
    "NODE":[nodes_map[tuple(Nodes_S[i])],nodes_map[tuple(Nodes_E[i])]],
    "ANGLE":Angle
    }
    Element_ID.append([start_ele_ID+i])
#post to gen
Nodes_ID=[ Value for Value in nodes_map]
NODES=midas_api("POST","/db/node",nodes_json)
beam=midas_api("POST","/db/elem",element_json)

print("Success")
# ---------- end gh_cpython_14 ----------

# ----
define_text_dot_3 = DefineTextDot(Text=series_3, Location=removeduplicatepts_2, Font="Arial", Size=14)

panel_19 = Panel("13")
panel_20 = Panel("22")
list_item_3 = ListItem(List=deconstruct_brep.Vertices, Index=0, Wrap=True)  # -> flatten(Item), flatten(Item1), flatten(Item2), flatten(Item3)

panel_21 = Panel("14")
boolean_toggle_3 = BooleanToggle(False)
list_item_4 = ListItem(List=deconstruct_brep_2.Vertices, Index=0, Wrap=True)  # -> flatten(Item), flatten(Item1), flatten(Item2), flatten(Item3)

panel_23 = Panel(gh_cpython_14.Element_ID)

# ---- group: 释放梁端约束
gh_cpython_15 = GH_CPython(Element_ID=gh_cpython_14.Element_ID, RestraintType="1")  # -> Constraint; inputs Element_ID: list, RestraintType: list
#   port Constraint: indicate your output description here. refers to a new line.
# ---------- gh_cpython_15: Python ----------
# -*- coding: utf-8 -*-
""" 
[desc]
"Restraint":{1:"hinge-hinge",2:"hinge-pinned",3:"pinned-hinge"
4:"pinned-pinned"}
[/desc]
"""
import requests
import json
import math
#define api function
import Midas_Gen_API
from Midas_Gen_API import *
restraint_json={"Assign":{}}
re_count=len(Element_ID)
for i in range(re_count):
    if RestraintType==1:
        RE_I="0000110"
        RE_J="0000110"
        value_i=[0,0,0,0,0.1,0.1,0]
        value_j=[0,0,0,0,0.1,0.1,0] #hinge-hinge
    elif RestraintType==2:
        RE_I="0000110"
        RE_J="0000000"
        value_i=[0,0,0,0,0.1,0.1,0]
        value_j=[0,0,0,0,0,0,0]#hinge-pinned
    elif RestraintType==3:
        RE_I="0000110"
        RE_J="0000000"
        value_i=[0,0,0,0,0,0,0]
        value_j=[0,0,0,0,0.1,0.1,0] #pinned-hinge
    elif RestraintType==4:
        RE_I="0000110"
        RE_J="0000000"
        value_i=[0,0,0,0,0,0,0]
        value_j=[0,0,0,0,0,0,0] #pinned-pinned
    restraint_json["Assign"][str(Element_ID[i])]={
"ITEMS":[
         {
        "ID":1,
        "bVALUE":False,
        "FLAG_I":RE_I,
        "VALUE_I":value_i,
        "FLAG_J":RE_J,
        "VALUE_J":value_j,
        
          }]
    }

#constraint_json={"Assign":{"1":{"ITEMS":[{"ID":1,"CONSTRAINT":"1000000"}]}}}
print(restraint_json)
#print(type(Nodes_Support))
      
Restraint=midas_api("POST", '/db/FRLS',restraint_json)
# ---------- end gh_cpython_15 ----------

# ---- group: 四点生成板单元
gh_cpython_16 = GH_CPython(
    s=Toggle(False),
    Slab=deconstruct_brep.Faces,
    Nodes=removeduplicatepts,
    Mat_ID="1",
    Sect_ID="1",
    Stype=Slider(1, range=0..1),
    N1=list_item_3.Item,
    N2=list_item_3.Item1,
    N3=list_item_3.Item2,
    N4=list_item_3.Item3)  # -> a, Element_ID; inputs s: list, start_node_ID: list, start_slab_ID: list, Slab: list, Nodes: list, Mat_ID: list, Sect_ID: list, BetaAngle: list, Stype: list, N1: list, N2: list, N3: list, N4: list
#   port Element_ID: indicate your output description here. refers to a new line.
# ---------- gh_cpython_16: Python ----------
# -*- coding: utf-8 -*-
# -*- coding: utf-8 -*-
""" 
[desc]
create Element :
Element Type
*   Plate : "PLATE"

Element Subtype"STYPE"
*   Thick : 1
*   Thick with Drilling DOF : 3
*   Thin : 2
*   Thin with Drilling DOF : 4
[/desc]
"""
import requests
import json
import math
#define api function
import Midas_Gen_API
from Midas_Gen_API import *

nodes_count=len(Nodes)
start_node_ID=start_node_ID
start_slab_ID=start_slab_ID
nodes_json = {"Assign" : {}}
nodes_map={}
if BetaAngle==None:
    Angle=0
else:
     Angle=BetaAngle
#create nodes
for i in range(nodes_count):
    nodes_json["Assign"][start_node_ID+i]={"X":Nodes[i][0],"Y":Nodes[i][1],"Z":Nodes[i][2]}
    nodes_map[tuple((Nodes[i]))]=i+start_node_ID
#print(nodes_map)
#create elements
slab_json={"Assign" :{}}
slab_count=len(Slab)
#create slab
if s:
    for i in range(slab_count):
        j1=nodes_map[tuple(N1[i])]
        j2=nodes_map[tuple(N2[i])]
        j3=nodes_map[tuple(N3[i])]
        j4=nodes_map[tuple(N4[i])]
        slab_json["Assign"][start_slab_ID+i]={
        "TYPE":"PLATE",
        "MATL":Mat_ID,
        "SECT":Sect_ID,
        "NODE":[j1,j2,j3,j4],
        "ANGLE":Angle,
        "STYPE":Stype
        }
    #print(slab_json)
      
#post to gen
NODES=midas_api("POST","/db/node",nodes_json)
slab=midas_api("POST","/db/elem",slab_json)
print("Success")
# ---------- end gh_cpython_16 ----------

# ----
panel_24 = Panel("""SBBBBBBBBBB
SDDDDDD""")

# ---- group: 四点生成墙单元
gh_cpython_17 = GH_CPython(
    start_node_ID="1",
    start_wall_ID="1",
    Wall=deconstruct_brep_2.Faces,
    Nodes=removeduplicatepts_2,
    Mat_ID="1",
    Sect_ID="1",
    LocalAxis="2",
    N1=list_item_4.Item,
    N2=list_item_4.Item1,
    N3=list_item_4.Item2,
    N4=list_item_4.Item3)  # -> a, Element_ID; inputs s: list, start_node_ID: list, start_wall_ID: list, Wall: list, Nodes: list, Mat_ID: list, Sect_ID: list, LocalAxis: list, N1: list, N2: list, N3: list, N4: list
#   port Element_ID: indicate your output description here. refers to a new line.
# ---------- gh_cpython_17: Python ----------
# -*- coding: utf-8 -*-
# -*- coding: utf-8 -*-
""" 
[desc]
create Element :
Element Type
*   Plate : "PLATE"

Element Subtype"STYPE"
*   Thick : 1
*   Thick with Drilling DOF : 3
*   Thin : 2
*   Thin with Drilling DOF : 4
[/desc]
"""
import requests
import json
import math
#define api function
import Midas_Gen_API
from Midas_Gen_API import *

nodes_count=len(Nodes)
start_node_ID=start_node_ID
start_wall_ID=start_wall_ID
nodes_json = {"Assign" : {}}
nodes_map={}
if LocalAxis==None:
    Axis=1
else:
    Axis=LocalAxis
#create nodes
for i in range(nodes_count):
    nodes_json["Assign"][start_node_ID+i]={"X":Nodes[i][0],"Y":Nodes[i][1],"Z":Nodes[i][2]}
    nodes_map[tuple((Nodes[i]))]=i+start_node_ID
print(nodes_json)
#create elements
wall_json={"Assign" :{}}
wall_count=len(Wall)
#create wall
if s:
    for i in range(wall_count):
        j1=nodes_map[tuple(N2[i])]
        j2=nodes_map[tuple(N3[i])]
        j3=nodes_map[tuple(N4[i])]
        j4=nodes_map[tuple(N1[i])]
        wall_json["Assign"][start_wall_ID+i]={
        "TYPE":"WALL",
        #"WALL":start_wall_ID+i,
        "MATL":Mat_ID,
        "SECT":Sect_ID,
        "W_CON":[j1,j2,j3,j4],
        "W_TYPE":1,
        "LCAXIS":LocalAxis,
        
        }
    print(wall_json)
      
#post to gen
NODES=midas_api("POST","/db/node",nodes_json)
wall=midas_api("POST","/db/elem",wall_json)
print("Success")
# ---------- end gh_cpython_17 ----------

# ----
panel_25 = Panel("""D
L""")
panel_26 = Panel("""DL
LL""")
panel_27 = Panel(list_item_4.Item)

# ---- group: 添加静力荷载工况
gh_cpython_18 = GH_CPython(CaseStartID="1", Name=panel_26, Type=panel_25, Desc=panel_24)  # -> CaseType; inputs CaseStartID: list, Name: list, Type: list, Desc: list
#   port CaseType: indicate your output description here. refers to a new line.
# ---------- gh_cpython_18: Python ----------
# -*- coding: utf-8 -*-
""" 
[desc]
"Dead Load":"D"
,"Live Load":"L","
Roof Live Load":"LR",
"Snow Load":"S",
"Rain Load":"R",
"Wind Load on Structure":"W",
"Tem":"T"
[/desc]
"""
import requests
import json
import math
#define api function
import Midas_Gen_API
from Midas_Gen_API import *
case_json={"Assign":{}}
case_count=len(Name)
if type(Name)==str:
    case_json["Assign"][CaseStartID]={
    "NAME":Name,
    "TYPE":"D",
    "DESC":Desc,
}

else:
    for i in range(case_count):
        case_json["Assign"][CaseStartID+i]={
        "NAME":Name[i],
        "TYPE":Type[i],
        "DESC":Desc[i],
}
#for i in range(case_count):
    
    
#constraint_json={"Assign":{"1":{"ITEMS":[{"ID":1,"CONSTRAINT":"1000000"}]}}}
#print(case_json)
#print(type(Nodes_Support))
CaseType=Type 
Case=midas_api("POST", '/db/STLD',case_json)
# ---------- end gh_cpython_18 ----------

# ----
panel_28 = Panel("BEAM")
panel_29 = Panel("""-20
-40""")
panel_30 = Panel("""9
11""")
panel_31 = Panel("""DL
DL""")
panel_32 = Panel("""0
0""")
boolean_toggle_4 = BooleanToggle(True)
panel_33 = Panel("GET")
panel_34 = Panel("""[-10,0,0,0]
[-20,0,0,0]
[-15,0,0,0]""")
panel_35 = Panel("""[0.5,0,0,0]
[0.2,0,0,0]
[0.8,0,0,0]""")
panel_36 = Panel(gh_cpython_18)
panel_37 = Panel("""1
0.5""")
gh_cpython_19 = GH_CPython(
    s=Toggle(False),
    start_node_ID="1",
    start_wall_ID="1",
    Wall=deconstruct_brep_2.Faces,
    Nodes=removeduplicatepts_2,
    Mat_ID="1",
    Sect_ID="1",
    LocalAxis="2",
    N1=list_item_4.Item,
    N2=list_item_4.Item1,
    N3=list_item_4.Item2,
    N4=list_item_4.Item3)  # -> a, Element_ID; inputs s: list, start_node_ID: list, start_wall_ID: list, Wall: list, Nodes: list, Mat_ID: list, Sect_ID: list, LocalAxis: list, N1: list, N2: list, N3: list, N4: list
#   port Element_ID: indicate your output description here. refers to a new line.
# ---------- gh_cpython_19: Python ----------
# -*- coding: utf-8 -*-
# -*- coding: utf-8 -*-
""" 
[desc]
create Element :
Element Type
*   Plate : "PLATE"

Element Subtype"STYPE"
*   Thick : 1
*   Thick with Drilling DOF : 3
*   Thin : 2
*   Thin with Drilling DOF : 4
[/desc]
"""
import requests
import json
import math
#define api function
import Midas_Gen_API
from Midas_Gen_API import *

nodes_count=len(Nodes)
start_node_ID=start_node_ID
start_wall_ID=start_wall_ID
nodes_json = {"Assign" : {}}
nodes_map={}
if LocalAxis==None:
    Axis=1
else:
    Axis=LocalAxis
#create nodes
for i in range(nodes_count):
    nodes_json["Assign"][start_node_ID+i]={"X":Nodes[i][0],"Y":Nodes[i][1],"Z":Nodes[i][2]}
    nodes_map[tuple((Nodes[i]))]=i+start_node_ID
print(nodes_json)
#create elements
wall_json={"Assign" :{}}
wall_count=len(Wall)
#create wall
if s:

    wall_json["Assign"]={"1":
    {#"TYPE":"WALL",
    #"WALL":start_wall_ID+i,
    "MATL":Mat_ID,
    "SECT":Sect_ID,
    "W_CON":[2,3,4,1],
    "W_TYPE":1,
    "LCAXIS":LocalAxis,
    
    }}
print(wall_json)
      
#post to gen
NODES=midas_api("POST","/db/node",nodes_json)
wall=midas_api("POST","/db/elem",wall_json)
print("Success")
# ---------- end gh_cpython_19 ----------
panel_38 = Panel("""LL
DL""")
panel_39 = Panel("""[-10,-10,0,0]
[-20,-20,0,0]
[15,15,0,0]""")
panel_40 = Panel("""[0,1,0,0]
[0.2,0.8,0,0]
[0.5,1,0,0]""")
panel_41 = Panel("""GZ
GZ
GZ""")
panel_42 = Panel("D")
panel_43 = Panel("""DL
DL
DL""")
panel_44 = Panel("""GZ
GZ
GZ""")
panel_46 = Panel("""1
3
5""")
panel_47 = Panel("""DL
LL
DL""")
panel_48 = Panel("""2
4
6""")
panel_49 = Panel("DL")

# ---- group: 添加节点荷载
gh_cpython_20 = GH_CPython(Node_ID=panel_30, LoadCaseName=panel_31, Fx=panel_32, Fy=panel_32, Fz=panel_29, Mx=panel_32, My=panel_32, Mz=panel_32)  # -> N_ID; inputs Node_ID: list, LoadCaseName: list, Fx: list, Fy: list, Fz: list, Mx: list, My: list, Mz: list, Method: list
#   port N_ID: indicate your output description here. refers to a new line.
# ---------- gh_cpython_20: Python ----------
# -*- coding: utf-8 -*-
""" 
[desc]

[/desc]
"""
import requests
import json
import math
from itertools import zip_longest
#define api function
import Midas_Gen_API
from Midas_Gen_API import *
Nload_json={"Assign":{}}

if type(Node_ID)==int:
    Nload_json["Assign"][Node_ID]={"ITEMS":[
    {"ID":"1",
     "LCNAME":LoadCaseName,
     "FX":Fx,
     "FY":Fy,
     "FZ":Fz,
     "MX":Mx,
     "MY":My,
     "MZ":Mz,}
]}
    
#print(bload_json)
else:
    load_count=len(Node_ID)
    for i in range(load_count):
        
        Nload_json["Assign"][Node_ID[i]]={"ITEMS":[
         {"ID":"1",
         "LCNAME":LoadCaseName[i],
         "FX":Fx[i],
         "FY":Fy[i],
         "FZ":Fz[i],
         "MX":Mx[i],
         "MY":My[i],
         "MZ":Mz[i]}]}
#print(Nload_json)

N_ID=Node_ID
Bload=midas_api(Method, '/db/CNLD',Nload_json)
# ---------- end gh_cpython_20 ----------

# ---- group: 自重
gh_cpython_21 = GH_CPython(SweightFactor="[0,0,-1]")  # -> Value; inputs LoadCaseName: list, SweightFactor: list
#   port Value: indicate your output description here. refers to a new line.
# ---------- gh_cpython_21: Python ----------
# -*- coding: utf-8 -*-
""" 
[desc]
Distance - [x1, x2, x3, x4]
LoadValue - [v1, v2, v3, v4]
[/desc]
"""
import requests
import json
import math
from itertools import zip_longest
#define api function
import Midas_Gen_API
from Midas_Gen_API import *

sweight_json={"Assign":{

        "1":{
            "LCNAME":LoadCaseName,
            "FV":SweightFactor,
            }
}}

    
#print(bload_json)

  
selfweight=midas_api("POST", '/db/BODF',sweight_json)
# ---------- end gh_cpython_21 ----------

# ---- group: 荷载转化为质量
gh_cpython_22 = GH_CPython(Dir="XY", bNode=boolean_toggle_4, bBEAM=boolean_toggle_4, bFLOOR=boolean_toggle_4, Factor=panel_37)  # -> LCName; inputs LoadCaseName: list, Dir: list, bNode: list, bBEAM: list, bFLOOR: list, Factor: list
#   port LCName: indicate your output description here. refers to a new line.
# ---------- gh_cpython_22: Python ----------
# -*- coding: utf-8 -*-
""" 
[desc]

[/desc]
"""
import requests
import json
import math

#define api function
import Midas_Gen_API
from Midas_Gen_API import *
mass_json={"Assign":{}}
  
   
mass_json={"Assign":{"1":{
"DIR":Dir,
"bNODAL":bNode,
"bBEAM": bBEAM,
"bFLOOR": bFLOOR,
"bPRES": True,
"GRAV": 9.806,
"vLC":[{ "LCNAME":LoadCaseName[0],
"FACTOR":Factor[0]},
{ "LCNAME":LoadCaseName[1],
"FACTOR":Factor[1]}]
 }}}
#print(mass_json)

LCName=LoadCaseName
MASS=midas_api("POST", '/db/LTOM',mass_json)
# ---------- end gh_cpython_22 ----------

# ---- group: 添加梁单元集中荷载
gh_cpython_23 = GH_CPython(Element_ID=panel_48, LoadCaseName=panel_43, LoadDriection=panel_41, Distance=panel_35, Value=panel_34)  # -> Value; inputs Element_ID: list, LoadCaseName: list, LoadDriection: list, Distance: list, Value: list
#   port Value: indicate your output description here. refers to a new line.
# ---------- gh_cpython_23: Python ----------
# -*- coding: utf-8 -*-
""" 
[desc]
Distance - [x1, x2, x3, x4]
LoadValue - [v1, v2, v3, v4]
[/desc]
"""
import requests
import json
import math
from itertools import zip_longest
#define api function
import Midas_Gen_API
from Midas_Gen_API import *
bload_json={"Assign":{}}
load_count=len(Element_ID)
if type(Element_ID)==int:
    bload_json["Assign"][Element_ID]={"ITEMS":[
    {"ID":"1",
     "LCNAME":LoadCaseName,
     "CMD":"BEAM",
     "TYPE":"CONLOAD",
     "DIRECTION":LoadDriection,
     "USE_PROJECTION": False,
     "USE_ECCEN": False,  
     "D":list(Distance),
     "P":list(Value)}]}
    
#print(bload_json)
else:
    for i in range(load_count):
        
        bload_json["Assign"][Element_ID[i]]={"ITEMS":[
         {"ID":"1",
         "LCNAME":LoadCaseName[i],
         "CMD":"BEAM",
         "TYPE":"CONLOAD",
         "DIRECTION":LoadDriection[i],
         "USE_PROJECTION": False,
         "USE_ECCEN": False,  
         "D":Distance[i],
         "P":Value[i]}]}
print(bload_json)

    
#print(bload_json)

  
Bload=midas_api("POST", '/db/BMLD',bload_json)
# ---------- end gh_cpython_23 ----------

# ----
cluster = Cluster()

# ---- group: 添加梁单元均布荷载
gh_cpython_24 = GH_CPython(Element_ID=panel_46, LoadCaseName=panel_47, LoadDriection=panel_44, Distance=panel_40, Value=panel_39)  # -> Value; inputs Element_ID: list, LoadCaseName: list, LoadDriection: list, Distance: list, Value: list
#   port Value: indicate your output description here. refers to a new line.
# ---------- gh_cpython_24: Python ----------
# -*- coding: utf-8 -*-
""" 
[desc]
Distance - [x1, x2, x3, x4]
LoadValue - [v1, v2, v3, v4]
[/desc]
"""
import requests
import json
import math
from itertools import zip_longest
#define api function
import Midas_Gen_API
from Midas_Gen_API import *
bload_json={"Assign":{}}
load_count=len(Element_ID)
if type(Element_ID)==int:
    bload_json["Assign"][Element_ID]={"ITEMS":[
    {"ID":"1",
     "LCNAME":LoadCaseName,
     "CMD":"BEAM",
     "TYPE":"UNILOAD",
     "DIRECTION":LoadDriection,
     "USE_PROJECTION": False,
     "USE_ECCEN": False,  
     "D":list(Distance),
     "P":list(Value)}]}
    
#print(bload_json)
else:
    for i in range(load_count):
        
        bload_json["Assign"][Element_ID[i]]={"ITEMS":[
         {"ID":"1",
         "LCNAME":LoadCaseName[i],
         "CMD":"BEAM",
         "TYPE":"UNILOAD",
         "DIRECTION":LoadDriection[i],
         "USE_PROJECTION": False,
         "USE_ECCEN": False,  
         "D":Distance[i],
         "P":Value[i]}]}
#print(bload_json)

    
#print(bload_json)

  
Bload=midas_api("POST", '/db/BMLD',bload_json)
# ---------- end gh_cpython_24 ----------

# ----
panel_50 = Panel(gh_cpython_20)
number_slider_3 = Slider(1, range=0..1)
panel_51 = Panel("PLATE")
panel_52 = Panel("""120
60""")
panel_53 = Panel("""2
4""")
panel_54 = Panel("""T1
T1""")
boolean_toggle_5 = BooleanToggle(False)
panel_55 = Panel("G:/2023年/06 攀枝花会展/2024/GEN文件")
panel_57 = Panel("0.002")
panel_58 = Panel("40")

# ---- group: 添加压力荷载
gh_cpython_25 = GH_CPython(LoadCaseName="DL", Direction="GZ", Value="[-10,0,0,0,0]")  # -> Value; inputs Element_ID: list, LoadCaseName: list, Direction: list, Value: list
#   port Value: indicate your output description here. refers to a new line.
# ---------- gh_cpython_25: Python ----------
# -*- coding: utf-8 -*-
""" 
[desc]
Dir:
Local-y : "LY"
Local-z : "LZ"
[/desc]
"""
import requests
import json
import math
from itertools import zip_longest
#define api function
import Midas_Gen_API
from Midas_Gen_API import *
pre_json={"Assign":{}}
if type(Element_ID)==int:
    pre_json["Assign"][Element_ID]={"ITEMS":[
    {"ID":"1",
     "LCNAME":LoadCaseName,
     "FACE_EDGE_TYPE": "FACE",
     "DIRECTION": Direction,
     "FORCES":Value
     }]}
    
#print(bload_json)
else:
    load_count=len(Element_ID)
    for i in range(load_count):
        
        etmp_json["Assign"][Element_ID[i]]={"ITEMS":[
         {"ID":"1",
         "LCNAME":LoadCaseName[i],
         "DIRECTION": Direction,
         "FORCES":Value[i]}]}
print(pre_json)

   
  
Tload=midas_api("POST", '/db/PRES',pre_json)
# ---------- end gh_cpython_25 ----------

# ----
panel_59 = Panel("""1.3
1.5""")
panel_60 = Panel("""DL
LL""")

# ---- group: 添加单元温度荷载
gh_cpython_26 = GH_CPython(LoadCaseName=panel_54, Value=panel_52)  # -> Value; inputs Element_ID: list, LoadCaseName: list, Value: list
#   port Value: indicate your output description here. refers to a new line.
# ---------- gh_cpython_26: Python ----------
# -*- coding: utf-8 -*-
""" 
[desc]
Dir:
Local-y : "LY"
Local-z : "LZ"
[/desc]
"""
import requests
import json
import math
from itertools import zip_longest
#define api function
import Midas_Gen_API
from Midas_Gen_API import *
etmp_json={"Assign":{}}
if type(Element_ID)==int:
    etmp_json["Assign"][Element_ID]={"ITEMS":[
    {"ID":"10",
     "LCNAME":LoadCaseName,
     "TEMP":Value
     }]}
    
#print(bload_json)
else:
    load_count=len(Element_ID)
    for i in range(load_count):
        
        etmp_json["Assign"][Element_ID[i]]={"ITEMS":[
         {"ID":"1",
         "LCNAME":LoadCaseName[i],
         "TEMP":Value[i]}]}
print(etmp_json)

   
  
Tload=midas_api("PUT", '/db/ETMP',etmp_json)
# ---------- end gh_cpython_26 ----------

# ---- group: 主控数据
gh_cpython_27 = GH_CPython()  # -> Value; inputs bArdc: list, bAnrc: list, Iter: list, Tol: list, bCsecf: list, bTrs: list, bCrbar: list, bBmstress: list
#   port Value: indicate your output description here. refers to a new line.
# ---------- gh_cpython_27: Python ----------
# -*- coding: utf-8 -*-
""" 
[desc]
Dir:
Local-y : "LY"
Local-z : "LZ"
[/desc]
"""
import requests
import json
import math
import Midas_Gen_API
from Midas_Gen_API import *

main_json={}
  
main_json=midas_api("GET", '/db/elem',)
print(main_json)
# ---------- end gh_cpython_27 ----------

# ---- group: P-Delta
gh_cpython_28 = GH_CPython(Iter="5", LCName=panel_60, Factor=panel_59)  # -> Value; inputs Iter: list, Tol: list, LCName: list, Factor: list
#   port Value: indicate your output description here. refers to a new line.
# ---------- gh_cpython_28: Python ----------
# -*- coding: utf-8 -*-
""" 
[desc]
P-Delta ansysis control

[/desc]
"""
import requests
import json
import math
from itertools import zip_longest
#define api function
import Midas_Gen_API
from Midas_Gen_API import *

if Tol==None:
    Tol=0.00001
else:
    Tol=Tol
items=[]
if type(LCName)==str:
    items=[
            {'LCNAME': LCName, 
            'FACTOR':Factor, 
            }]
else:
    count=len(LCName)
    for i in range(count):
        items.append({'LCNAME': LCName[i], 
                      'FACTOR':Factor[i], 
                      })
delta_json={"Assign":{
                      "1":  {
                            "ITER": Iter,
                            "TOL": Tol,
                            "PDEL_CASES": items}}}

#print(eigen_json)
DEL=midas_api("POST", '/db/PDEL',delta_json)
# ---------- end gh_cpython_28 ----------

# ---- group: 主控数据
gh_cpython_29 = GH_CPython(Tol="0.002")  # -> Value; inputs bArdc: list, bAnrc: list, Iter: list, Tol: list, bCsecf: list, bTrs: list, bCrbar: list, bAcwc: list, bBmstress: list
#   port Value: indicate your output description here. refers to a new line.
# ---------- gh_cpython_29: Python ----------
# -*- coding: utf-8 -*-
""" 
[desc]
Dir:
Local-y : "LY"
Local-z : "LZ"
[/desc]
"""
import requests
import json
import math
from itertools import zip_longest
#define api function
import Midas_Gen_API
from Midas_Gen_API import *

if bArdc==None:
    bArdc=True
else:
    bArdc=bArdc
if bAnrc==None:
    bAnrc=True
else:
    bAnrc=bAnrc
if bCsecf==None:
    bCsecf=False
else:
    bCsecf=bCsecf
if bTrs==None:
    bTrs=True
else:
    bTrs=bTrs
if bCrbar==None:
    bCrbar=True
else:
    bCrbar=bCrbar
if bAcwc==None:
    bAcwc=True
else:
   bAcwc=bAcwc
if bBmstress==None:
    bCrbar=False
else:
   bBmstress=bBmstress

main_json={"Assign":{
                    "1":{
                        "ARDC":bArdc,
                        "ANRC": bAnrc,
                        "ITER": Iter,
                        "TOL":Tol,
                        "CSECF": bCsecf,
                        "TRS": bTrs,
                        "CRBAR": bCrbar,
                        "ACWC":bAcwc,
                        "BMSTRESS": bBmstress,
                        "CLATS": True
}


}}

   
  
MainC=midas_api("POST", '/db/ACTL',main_json)
# ---------- end gh_cpython_29 ----------

# ---- group: 查看梁单元内力
gh_cpython_30 = GH_CPython(TableName="BEAMFORCE", EXFilePath=panel_55)  # -> Log; inputs Run: list, ElementID: list, TableName: list, EXFilePath: list
# ---------- gh_cpython_30: Python ----------
# -*- coding: utf-8 -*-
""" 
[desc]
Ansys

[/desc]
"""
import requests
import json
import math

#define api function
import Midas_Gen_API
from Midas_Gen_API import *

b_json={"Argument":{

            "TABLE_NAME":TableName,
            "EXPORT_PATH":EXFilePath,
            "TABLE_TYPE": "BEAMFORCE",
            "NODE_ELEMS": {
                "TO":"1 to 10"},
            "LOAD_CASE_NAME":["DL(ST)"],
            "PARTS": [
                "Part I",
                "Part 1/4",
                "Part 1/2",
                "Part 3/4",
                "Part J"
        ],
            "COMPONENTS": [
                "Elem",
                "Load",
                "Part",
                "Axial",
                "Shear-y",
                "Shear-z",
                "Torsion",
                "Moment-y",
                "Moment-z"
        ]



}}

print(b_json)
table=midas_api("POST", '/POST/TABLE',b_json)
Log=table
# ---------- end gh_cpython_30 ----------

# ---- group: 查看位移
gh_cpython_31 = GH_CPython(TableName="BEAMFORCE", EXFilePath=panel_55)  # -> Log; inputs Run: list, ElementID: list, TableName: list, EXFilePath: list
# ---------- gh_cpython_31: Python ----------
# -*- coding: utf-8 -*-
""" 
[desc]
Ansys

[/desc]
"""
import requests
import json
import math

#define api function
import Midas_Gen_API
from Midas_Gen_API import *

D_json={"Argument":{

        "TABLE_NAME": "Example",
        "EXPORT_PATH" : EXFilePath,
        "TABLE_TYPE": "DISPLACEMENTG",
        "NODE_ELEMS": {
              "KEYS": [ 21 ]
        },
        "LOAD_CASE_NAMES": [
            "DL"
        ],
        "COMPONENTS": [
            "Node",
            "Load",
            "DX",
            "DY",
            "DZ",
            "RX",
            "RY",
            "RZ"
        ]
  }
}


print(D_json)
table=midas_api("POST", '/POST/TABLE',D_json)
Log=table
# ---------- end gh_cpython_31 ----------

# ----
boolean_toggle_6 = BooleanToggle(True)

# ---- group: 运行分析
gh_cpython_32 = GH_CPython(Run=Toggle(False))  # -> Log; inputs Run: list
# ---------- gh_cpython_32: Python ----------
# -*- coding: utf-8 -*-
""" 
[desc]
Ansys

[/desc]
"""
import requests
import json
import math

#define api function
import Midas_Gen_API
from Midas_Gen_API import *
ansys_json={}
def fun(bool):
    try:
        any=midas_api("POST", '/doc/Anal',ansys_json)
    except Exception as e:
        Log=e
re=fun(Run)
# ---------- end gh_cpython_32 ----------

# ----
panel_62 = Panel("""DL
LL""")
panel_66 = Panel("""1.5
1.0""")
panel_67 = Panel("""1
0""")
panel_68 = Panel(gh_cpython_30)
panel_69 = Panel(gh_cpython_32)
panel_70 = Panel(gh_cpython_31)

# ---- group: 屈曲分析控制数据
gh_cpython_33 = GH_CPython(
    bPostive=boolean_toggle_6,
    bConAxis=boolean_toggle_6,
    From="0",
    To="0",
    LcName=panel_62,
    Factor=panel_66,
    LoadType=panel_67)  # -> Value; inputs NumMode: list, bPostive: list, bConAxis: list, From: list, To: list, LcName: list, Factor: list, LoadType: list
#   port Value: indicate your output description here. refers to a new line.
# ---------- gh_cpython_33: Python ----------
# -*- coding: utf-8 -*-
""" 
[desc]
Dir:
Local-y : "LY"
Local-z : "LZ"
[/desc]
"""
import requests
import json
import math
from itertools import zip_longest
#define api function
import Midas_Gen_API
from Midas_Gen_API import *

if bPostive==None:
    bPostive=True
else:
    bPostive=bPostive
if bConAxis==None:
    bConAxis=False
else:
    bConAxis=bConAxis
items=[]
if type(LcName)==str:
    items=[
            {'LCNAME': LcName, 
            'FACTOR':Factor, 
            'LOAD_TYPE': LoadType}]
else:
    count=len(LcName)
    for i in range(count):
        items.append({'LCNAME': LcName[i], 
                      'FACTOR':Factor[i], 
                      'LOAD_TYPE': LoadType[i]})

buckling_json={"Assign":{
                    "1": {'MODE_NUM': NumMode, 
                            'OPT_POSITIVE': bPostive, 
                            'OPT_CONSIDER_AXIAL_ONLY': bConAxis,
                            'LOAD_FACTOR_FROM': From, 
                            'LOAD_FACTOR_TO': To, 
                            'OPT_STURM_SEQ': False, 
                            'ITEMS':items
                }}}


MainC=midas_api("POST", '/db/buck',buckling_json)
# ---------- end gh_cpython_33 ----------

# ----
panel_71 = Panel("""10
10
10""")
panel_72 = Panel("""ACCX
ACCY
ACCZ""")

# ---- group: 非线性分析控制Newton法
gh_cpython_34 = GH_CPython(
    NonlinearType="GEOM",
    NumStep="1",
    NumIter="30",
    bDisplacement=Toggle(True),
    Displacement=Slider(0.002, range=0..0.01),
    LCName="DL",
    SubNumStep="1",
    SubIter="30",
    LoadFactor="1")  # -> Value; inputs NonlinearType: list, NumStep: list, NumIter: list, bEnergy: list, Energy: list, bDisplacement: list, Displacement: list, bForce: list, Force: list, LCName: list, SubNumStep: list, SubIter: list, LoadFactor: list
#   port Value: indicate your output description here. refers to a new line.
# ---------- gh_cpython_34: Python ----------
# -*- coding: utf-8 -*-
""" 
[desc]
Nonlinear ansysis control
[/desc]
"""
import requests
import json
import math
from itertools import zip_longest
#define api function
import Midas_Gen_API
from Midas_Gen_API import *

if  bEnergy==None:
    bEnergy=False
    Energy=0.001
else:
    bEnergy=bEnergy
    Energy=Energy

if  bDisplacement==None:
    bDisplacement=True
    Displacement=0.001
else:
    bDisplacement=bDisplacement
    Displacement=Displacement

if bForce==None:
    bForce=False
    Force=0.001
nlct_json={'Assign': {
                    '1': 
                        {'NONLINEAR_TYPE': NonlinearType, 
                        'ITERATION_METHOD': 'NEWTON',
                        'NUMBER_STEPS': NumStep, 
                        'MAX_ITERATIONS': NumIter,
                        'OPT_ENERGY_NORM':bEnergy,
                        'ENERGY_NORM': Energy, 
                        'OPT_DISPLACEMENT_NORM':bDisplacement, 
                        'DISPLACEMENT_NORM': Displacement,
                        'OPT_FORCE_NORM': bForce, 
                        'FORCE_NORM': Force, 
                        'NEWTON_ITEMS': 
                            [{'ITERATION_METHOD': 'NEWTON', 
                            'LCNAME':LCName, 
                            'NUMBER_STEPS': SubNumStep,
                            'MAX_ITERATIONS': SubIter,
                            'LOAD_FACTORS': [LoadFactor]}]}}}

print(nlct_json)
Nlct=midas_api("POST", '/db/NLCT',nlct_json)
# ---------- end gh_cpython_34 ----------

# ---- group: Ritz向量法
gh_cpython_35 = GH_CPython(iNog=panel_71)  # -> Value; inputs bIncnl: list, iGnum: list, Ground: list, iNog: list
#   port Value: indicate your output description here. refers to a new line.
# ---------- gh_cpython_35: Python ----------
# -*- coding: utf-8 -*-
""" 
[desc]
Dir:
Local-y : "LY"
Local-z : "LZ"
[/desc]
"""
import requests
import json
import math
from itertools import zip_longest
#define api function
import Midas_Gen_API
from Midas_Gen_API import *

if bIncnl==None:
    bIncnl=False
else:
    bIncnl=bIncnl
vritz=[]
if type(iNog)==int:
    vritz=[{
            "KIND": "GROUND",
            "GROUND": Ground,
            "iNOG": iNog}]
else:
    count=len(iNog)
    for i in range(count):
        vritz.append({
            "KIND": "GROUND",
            "GROUND": Ground[i],
            "iNOG": iNog[i]})
eigen_json={"Assign":{
                      "1":  {
                            "TYPE": "RITZ",
                            "bINCNL": bIncnl,
                            "iGNUM": iGnum,
                            "vRITZ": vritz}}}

#print(eigen_json)
EIG=midas_api("POST", '/db/EIGV',eigen_json)
# ---------- end gh_cpython_35 ----------

# ---- group: 特征值向量分析
gh_cpython_36 = GH_CPython(iFreq="20")  # -> Value; inputs Type: list, iFreq: list, iITer: list, iDim: list, Tol: list, bMinmax: list, Min: list, Max: list, bStrum: list
#   port Value: indicate your output description here. refers to a new line.
# ---------- gh_cpython_36: Python ----------
# -*- coding: utf-8 -*-
""" 
[desc]
Dir:
Local-y : "LY"
Local-z : "LZ"
[/desc]
"""
import requests
import json
import math
from itertools import zip_longest
#define api function
import Midas_Gen_API
from Midas_Gen_API import *

if Type==None:
    Type="LANCZOS"
else:
    Type=Type
if bMinmax==None:
    bMinmax=False
else:
    bMinmax=bMinmax


eigen_json={"Assign":{
                      "1": {
                        "TYPE": Type,
                        "iFREQ": iFreq,
                        "iITER": 20,
                        "iDIM": 1,
                        "TOL": 1e-10,
                        "bMINMAX": bMinmax,
                        "FRMIN": 0,
                        "FRMAX": 0,
                        "bSTRUM": False
                }}}


EIG=midas_api("POST", '/db/EIGV',eigen_json)
# ---------- end gh_cpython_36 ----------

# ----
point = Point(<point referenced from the Rhino model>)
define_text_dot_4 = DefineTextDot(Text="1", Location=point, Font="Arial", Size=14)
deconstruct = Deconstruct(Point=point)  # -> XComponent, YComponent, ZComponent
panel_73 = Panel(deconstruct.ZComponent)

# ---- group: 设置材料属性，支持连续添加同一类型材料
gh_cpython_37 = GH_CPython(Mat_ID="1", MatType="CONC", MatName="C30", P_Type="1", Mat_Grade="C30", Damp_Rat="0.03")  # -> Mat_ID, StandardName; inputs Mat_ID: list, MatType: list, MatName: list, P_Type: list, Mat_Grade: list, Damp_Rat: list
# ---------- gh_cpython_37: Python ----------
# -*- coding: utf-8 -*-
""" 
[desc]
MatType:"CONC","STEEL","SRC"
Mat_ID:int type ,list
P_type:Type of Design
*   User Defined : 2
*   Orthotropic : 3
*   Other Cases : 1
Standard:"GB10(RC)","GB50017-17(S)"
Damp_Rat:"CONC":default 0.05,"STEEL":default 0.02
[/desc]
"""
import requests
import json
import math
#define api function
import Midas_Gen_API
from Midas_Gen_API import *
StandardName=""
if Damp_Rat==None and MatType=="CONC" :
    Damp_Rat=0.05
elif Damp_Rat==None and MatType=="STEEL" :
    Damp_Rat=0.02
else:
     Damp_Rat= Damp_Rat   
if MatType=="CONC":
    StandardName="GB10(RC)"   
elif MatType=="STEEL":
    StandardName="GB50017-17(S)"
    
mat_json={"Assign":{}}
if type(P_Type)==int:
    mat_json["Assign"][Mat_ID]={
            "TYPE":MatType,
            "NAME":MatName,
            "DAMP_RAT":Damp_Rat,
            "PARAM":[{
                "P_TYPE":P_Type,
                "STANDARD":StandardName,
                "DB":Mat_Grade}]
            }
else:
    for mat_id_item in range(Mat_ID[0],len(Mat_ID)+Mat_ID[0]):
        mat_json["Assign"][mat_id_item]={
            "TYPE":MatType,
            "NAME":MatName[mat_id_item-Mat_ID[0]],
            "DAMP_RAT":Damp_Rat,
            "PARAM":[{
                "P_TYPE":P_Type,
                "STANDARD":StandardName,
                "DB":Mat_Grade[mat_id_item-Mat_ID[0]]}]
            
    }
print(json.dumps(mat_json,indent=4,ensure_ascii=False
    
))
MAT=midas_api("POST", '/db/matl',mat_json)
# ---------- end gh_cpython_37 ----------

# ----
panel_74 = Panel(gh_cpython_37.Mat_ID)
panel_75 = Panel(gh_cpython_37.StandardName)

# ==== cluster Cluster: 这是一个小哦哦哦哦哦
beam = Beam()
